# Grasshopper definition parametric_lca.gh (Grasshopper 1.0.9)

quantity = Python3Script(value=Slider(0.1, range=0..1), unit="W/m*K")  # -> out, quantity; inputs unit: String
# ---------- quantity: Python ----------
from pod_lca_buildings_tool.units import quantity_from_value_unit

quantity = quantity_from_value_unit(value, unit)
# ---------- end quantity ----------
quantity_2 = Python3Script(value=Slider(1.5, range=0..10), unit="in")  # -> out, quantity; inputs unit: String; same code as quantity
materialpropertymass_fromidf = Python3Script(name="Mineral wool blanket baseline")  # -> out, material_property; inputs name: String
# ---------- materialpropertymass_fromidf: Python ----------
from pod_lca_buildings_tool.material_properties import material_property_mass_from_idf

material_property = material_property_mass_from_idf(name)
# ---------- end materialpropertymass_fromidf ----------
materialpropertymass_fromidf_2 = Python3Script(name="Gypsum board")  # -> out, material_property; inputs name: String; same code as materialpropertymass_fromidf
materialpropertymass_fromidf_3 = Python3Script(name="Gypsum board")  # -> out, material_property; inputs name: String; same code as materialpropertymass_fromidf
materialpropertyairgap_fromidf = Python3Script(name="Generic Wall Air Gap")  # -> out, material_property; inputs name: String
# ---------- materialpropertyairgap_fromidf: Python ----------
from pod_lca_buildings_tool.material_properties import material_property_air_gap_from_idf

material_property = material_property_air_gap_from_idf(name)
# ---------- end materialpropertyairgap_fromidf ----------
materialpropertymass_fromidf_4 = Python3Script(name="Clay Brick")  # -> out, material_property; inputs name: String; same code as materialpropertymass_fromidf
materialpropertynomass = Python3Script(
    name="Expanded polystyrene (EPS) Type 1",
    conductivity=quantity.quantity,
    thickness=quantity_2.quantity,
    roughness="MediumRough")  # -> out, material_property; inputs name: String
# ---------- materialpropertynomass: Python ----------
from pod_lca_buildings_tool.material_properties import material_property_no_mass

material_property = material_property_no_mass(name,
                                              conductivity,
                                              thickness,
                                              roughness,
                                              thermal_absorptance=.9,
                                              solar_absorptance=.7, 
                                              visible_absorptance=.7)
# ---------- end materialpropertynomass ----------
materialpropertymass_fromidf_5 = Python3Script(name="Softwood Lumber")  # -> out, material_property; inputs name: String; same code as materialpropertymass_fromidf
quantity_3 = Python3Script(value=Slider(2, range=0..10), unit="in")  # -> out, quantity; inputs unit: String; same code as quantity
quantity_4 = Python3Script(value=Slider(0.5, range=0..1), unit="in")  # -> out, quantity; inputs unit: String; same code as quantity
quantity_5 = Python3Script(value=Slider(0.5, range=0..1), unit="in")  # -> out, quantity; inputs unit: String; same code as quantity
quantity_6 = Python3Script(value=Slider(12, range=0..100), unit="in")  # -> out, quantity; inputs unit: String; same code as quantity
quantity_7 = Python3Script(value=Slider(3.5, range=0..10), unit="in")  # -> out, quantity; inputs unit: String; same code as quantity
quantity_8 = Python3Script(value=Slider(1.5, range=0..10), unit="in")  # -> out, quantity; inputs unit: String; same code as quantity
quantity_9 = Python3Script(value=Slider(1.5, range=0..10), unit="in")  # -> out, quantity; inputs unit: String; same code as quantity
quantity_10 = Python3Script(value=Slider(0.75, range=0..1), unit="in")  # -> out, quantity; inputs unit: String; same code as quantity
quantity_11 = Python3Script(value=Slider(1.5, range=0..10), unit="in")  # -> out, quantity; inputs unit: String; same code as quantity
layer = Python3Script(
    name="Mineral wool blanket baseline",
    material_property=materialpropertymass_fromidf.material_property,
    thickness=quantity_3.quantity,
    classification="framing_insulation")  # -> out, layer
# ---------- layer: Python ----------
from pod_lca_buildings_tool.layers import layer_from_material_property_and_thickness

layer = layer_from_material_property_and_thickness(name,
                                                   material_property,
                                                   thickness,
                                                   classification)
# ---------- end layer ----------
layer_2 = Python3Script(
    name="Gypsum board",
    material_property=materialpropertymass_fromidf_2.material_property,
    thickness=quantity_4.quantity,
    classification="interior_finish")  # -> out, layer; same code as layer
layer_3 = Python3Script(
    name="Gypsum board",
    material_property=materialpropertymass_fromidf_3.material_property,
    thickness=quantity_5.quantity,
    classification="sheathing")  # -> out, layer; same code as layer
layer_4 = Python3Script(
    name="Generic Wall Air Gap",
    material_property=materialpropertyairgap_fromidf.material_property,
    thickness=quantity_9.quantity,
    classification="air_gap")  # -> out, layer; same code as layer
layer_5 = Python3Script(
    name="Clay Brick",
    material_property=materialpropertymass_fromidf_4.material_property,
    thickness=quantity_10.quantity,
    classification="exterior_cladding")  # -> out, layer; same code as layer
layer_6 = Python3Script(
    name="Expanded polystyrene (EPS) Type 1",
    material_property=materialpropertynomass.material_property,
    thickness=quantity_11.quantity,
    classification="exterior_insulation")  # -> out, layer; same code as layer
woodframing = Python3Script(
    name="Timber Framing",
    material_property=materialpropertymass_fromidf_5.material_property,
    spacing=quantity_6.quantity,
    width=quantity_8.quantity,
    length=quantity_7.quantity)  # -> out, framing
# ---------- woodframing: Python ----------
from pod_lca_buildings_tool.framings import wooden_framing_from_parameters

framing = wooden_framing_from_parameters(name,
                                         material_property,
                                         spacing,
                                         width,
                                         length)
# ---------- end woodframing ----------
framedwall = Python3Script(
    name="Framed wall tomas",
    layers=[layer_5.layer, layer_4.layer, layer_6.layer, layer_3.layer, layer.layer, layer_2.layer],
    framing=woodframing.framing)  # -> out, framed_wall; inputs layers: list
# ---------- framedwall: Python ----------
from pod_lca_buildings_tool.walls import framed_wall_from_layers_and_framing


framed_wall = framed_wall_from_layers_and_framing(name, layers, framing)
# ---------- end framedwall ----------
panel = Panel(framedwall.framed_wall)
